# Grasshopper definition 1_1列表List.gh (Grasshopper 1.0.7)

number_slider = Slider(100, range=0..100)
number_slider_2 = Slider(4, range=0..10)
panel = Panel("索引")
panel_2 = Panel("""使用了for循环建立索引
只能建立列表索引值""")
number_slider_3 = Slider(1, range=0..10)
panel_3 = Panel("分片")
panel_4 = Panel("列表基本操作")
panel_5 = Panel("列表的方法")
neg = Negative(Value=number_slider)
panel_6 = Panel("""gh节点可视化编程不需太关注语法但是复杂时变得特别难读
结合Python来处理，让程序简单""")
line = Line(Line((742.3818935, -320.0377817, 0), (742.3818935, 498.9997827, 0)))
dom = ConstructDomain(DomainStart=neg, DomainEnd=number_slider)
X = UnitX(Factor=Slider(238, range=0..1000))

# ---- group: 提取数据
python = GhPythonScript(x=number_slider_3, y=number_slider_2)  # -> out, rectangle, dpoints, dpointe, dpointx, spheres, cube; inputs x: Int32, y: Int32
# ---------- python: Python ----------
__author__ = "billpower"
__version__ = "2019.12.25"

import rhinoscriptsyntax as rs

plane = rs.WorldXYPlane()   #获取xy以原点为中心的参考平面
rectangle = rs.AddRectangle(plane,40,40)

dpointsCoordinate = rs.DivideCurve(rectangle,10) #等分10矩形
dpoints = rs.AddPoints(dpointsCoordinate)   #增加等分点
print(dpoints)

format = "point_%s" #格式化字符串的模式
dpointe = []
i = 0
for i in  range(len(dpoints)):
    dpointe.append(format % str(i)) #格式化字符串并逐一追加到列表
print(dpointe)

dpointx = list(range(len(dpoints))) #建立等分点索引
print(dpointx)

#切片索引，建球
selepoints = dpoints[x:y]
spheres = []
print(selepoints)
for i in range(len(selepoints)):
    sphere = rs.AddSphere(selepoints[i],3)  #提取[y](圆心，半径)
    cube = rs.AddBox(rs.BoundingBox(sphere))    #（物体，plane）
    spheres.append(cube)
#    id = rs.GetObject(sphere)
#    if id: rs.DeleteObject()

print(spheres)
# ---------- end python ----------

# ---- group: 递进数据处理
python_2 = GhPythonScript(x=number_slider_3, y=number_slider_2)  # -> out, rectangle, dpoints, dpointe, dpointx, spheres, cube; inputs x: Int32, y: Int32
# ---------- python_2: Python ----------
__author__ = "billpower"
__version__ = "2019.12.25"

import rhinoscriptsyntax as rs

plane = rs.WorldXYPlane()   #��ȡxy��ԭ��Ϊ���ĵĲο�ƽ��
rectangle = rs.AddRectangle(plane,40,40)

dpointsCoordinate = rs.DivideCurve(rectangle,10) #�ȷ�10����
dpoints = rs.AddPoints(dpointsCoordinate)   #���ӵȷֵ�
print(dpoints)

format = "point_%s" #��ʽ���ַ�����ģʽ
dpointe = []
i = 0
for i in  range(len(dpoints)):
    dpointe.append(format % str(i)) #��ʽ���ַ�������һ׷�ӵ��б�
print(dpointe)

dpointx = list(range(len(dpoints))) #�����ȷֵ�����
print(dpointx)

#��Ƭ����������
selepoints = dpoints[x:y]
cubes = []
print(selepoints)
for i in range(len(selepoints)):
    sphere = rs.AddSphere(selepoints[i],3)  #��ȡ[y](Բ�ģ��뾶)
    cube = rs.AddBox(rs.BoundingBox(sphere))    #�����壬plane��
#    id = rs.GetObject(sphere)
#    if id: rs.DeleteObject()
    xform = rs.XformTranslation([i,i*5,i*5])    #x������ƶ�����
    trancube = rs.TransformObject(cube,xform)   #�ƶ�����
    cubes.append(trancube)
print(cubes)
# ---------- end python_2 ----------

# ---- group: 数据切片
python_3 = GhPythonScript()  # -> out, a
# ---------- python_3: Python ----------
__author__ = "billpower"
__version__ = "2019.12.25"

import rhinoscriptsyntax as rs

number = list(range(10))
print(number)

a = number[3:6]
print(a)

b = number[-5:-1]
print(b)

c = number[4:]
print(c)
# ---------- end python_3 ----------

# ----
python_4 = GhPythonScript()  # -> out, offsetlineA, offsetlineB, centercurve, a, lineAps, lineBps, lineCps, pla, plb
# ---------- python_4: Python ----------
__author__ = "billpower"
__version__ = "2019.12.27"

import rhinoscriptsyntax as rs
import Grasshopper as gh

#start建立基本结构线
basicpoint = rs.GetPoint("pick one point")  #1.拾取一个点
matrix  = rs.XformTranslation((80,0,0)) #建立用于移动的矩阵
mbpoint = rs.PointTransform(basicpoint,matrix)  #根据建立的矩阵移动点

basicline = rs.AddLine(basicpoint,mbpoint)  #2.建立一条直线

offsetdistance = 10
offsetlineA = rs.OffsetCurve(basicline,[0,0,0],offsetdistance,[0,0,1])  #3.偏移复制直线
offsetlineB = rs.OffsetCurve(basicline,[0,0,0],-offsetdistance,[0,0,1])

#调整结构线，使用提取点移动
extendvalue = 2    #中间直线延长的距离
extendline = rs.ExtendCurveLength(basicline,0,2,extendvalue)    #4.延长中间直线

startpoint = rs.CurveStartPoint(extendline)    #5.拾取两侧端点
endpoint = rs.CurveEndPoint(extendline)
midpoint = rs.CurveMidPoint(extendline)

heightA = 10
heightB = 18
matrixstartend = rs.XformTranslation((0,0,heightA))    #建立端点移动矩阵
matrixmid = rs.XformTranslation((0,0,heightB))      #建立中间点移动矩阵

mstartpoint = rs.PointTransform(startpoint,matrixstartend)  #根据矩阵移动开始点
mendpoint = rs.PointTransform(endpoint,matrixstartend)   #移动结束点
mmidpoint = rs.PointTransform(midpoint,matrixmid)   #移动中心点

#整理变量到列表
cpoints = []
cpoints.extend([mstartpoint,mmidpoint,mendpoint])   #追加移动后的点在一个列表中

centercurve = rs.AddCurve(cpoints)  #6.建立有弧度的曲线
#rs.DeleteObject(basicline)
#基本结构线已建立

#建立等分点与数据组织
divicount = 14 #建立等分点变量
Adivipoints = rs.DivideCurve(offsetlineA,divicount)
Bdivipoints = rs.DivideCurve(offsetlineB,divicount)
cendivipoints = rs.DivideCurve(centercurve,divicount)

#在rhino空间中建立点
rs.AddPoints(Adivipoints)
rs.AddPoints(Bdivipoints)
rs.AddPoints(cendivipoints)

#检查变量
patternA = list(range(0,len(Adivipoints),2))
patternB = list(range(1,len(Adivipoints)+1,2))
print(patternA)
print(patternB)

#建立列表
lineAps = []
lineBps = []
lineCps = []

#循环语句，同时分别提取保留点
for i in patternA:
    lineAps.append(Adivipoints[i])
    lineBps.append(Bdivipoints[i])
    lineCps.append(cendivipoints[i])

#复制第三条结构线保留等分点，错开插入中心线列表
lineCpsc = lineCps[:]   
for i in range(len(patternB)):
    lineCps.insert(patternB[i],lineAps[i])
    lineCpsc.insert(patternB[i],lineBps[i])

pla = rs.AddPolyline(lineCps)
plb = rs.AddPolyline(lineCpsc)
# ---------- end python_4 ----------

# ---- group: 构建矩形加入索引
python_5 = GhPythonScript()  # -> out, rectangle, dpoints, dpointe, dpointx
# ---------- python_5: Python ----------
__author__ = "billpower"
__version__ = "2019.12.25"

import rhinoscriptsyntax as rs

plane = rs.WorldXYPlane()   #获取xy以原点为中心的参考平面
rectangle = rs.AddRectangle(plane,40,40)

dpointsCoordinate = rs.DivideCurve(rectangle,10) #等分10矩形
dpoints = rs.AddPoints(dpointsCoordinate)   #增加等分点
print(dpoints)

format = "point_%s" #格式化字符串的模式
dpointe = []
i = 0
for i in  range(len(dpoints)):
    dpointe.append(format % str(i)) #格式化字符串并逐一追加到列表
print(dpointe)

dpointx = list(range(len(dpoints))) #建立等分点索引
print(dpointx)
# ---------- end python_5 ----------

# ----
pt = Point(python_5.dpoints)
rectangle = Rectangle(Plane=PlaneXY(0, 0, 0), XSize=dom, YSize=dom, Radius=0)  # -> Rectangle, Length
move = Move(Geometry=line, Motion=X)  # -> Geometry, Transform
division = Division(A=X, B=2)
item = ListItem(List=pt, Index=Slider(2, range=0..10), Wrap=True)
brep = Brep(python.spheres)

# ---- group: 切片列表处理
python_6 = GhPythonScript()  # -> out, a
# ---------- python_6: Python ----------
__author__ = "billpower"
__version__ = "2019.12.25"

import rhinoscriptsyntax as rs

lst = list(range(10))
print(lst)

lst[5] = 99

lstnone = lst + [None]*6    #��Ҫ�����������ݵ�����ֵʱ��ͨ������none��ֵ
print(lstnone)

lstnone[-6:-2] = list(range(100,106,2)) #��Ƭ��ֵ������ͬʱ�滻�����ֵ

lstnone[:3] = []    #��ֵ�б�Ϊ�գ�����ɾ��ָ������ֵ
print(lstnone)

lstnone[1:1] = [0,0,-3,-4]  #ָ����ʼ�������ͬʱ���൱�ڲ�����ֵ
print(lstnone)

del lstnone[-2:]    #delɾ��ָ��ֵ
print(lstnone)
# ---------- end python_6 ----------

# ----
dom_2 = ConstructDomain(DomainStart=0, DomainEnd=1)
panel_7 = Panel("""通过循环，使得偏移位置逐渐发生变化

递进式的计算在python下显得更方便和快速""")
divide = DivideCurve(Curve=rectangle.Rectangle, Count="10", Kinks=False)  # -> Points, Tangents, Parameters
move_2 = Move(Geometry=line, Motion=division)  # -> Geometry, Transform
Z = UnitZ(Factor=division)
panel_8 = Panel(brep)
subset = SubList(List=pt, Domain=dom_2, Wrap=True)  # -> List, Index
box = CenterBox(Base=item, X=1, Y=1, Z=1)
python_7 = GhPythonScript(List=divide.Points)  # -> out, DataOut, dpoints; inputs List: list
# ---------- python_7: Python ----------
__author__ = "billpower"
__version__ = "2019.12.24"

import rhinoscriptsyntax as rs

dpoints = List  #定义来源数据
dpointx = list(range(len(dpoints))) #建立数据索引列表

DataOut = List  #输出源数据
dpointx = dpointx   #输出索引

print(dpointx)  #输出数据检查
print(dpoints)
# ---------- end python_7 ----------
move_3 = Move(Geometry=move_2.Geometry, Motion=Z)  # -> Geometry, Transform
panel_9 = Panel("""gh在处理多出数据的时候是一个静态的过程
python在循环中加入变化的参数语句,动态""")
end = EndPoints(Curve=move_3.Geometry)  # -> Start, End
Z_2 = UnitZ(Factor=1)
panel_10 = Panel(python_7.DataOut)

# ---- group: 多数据计算
python_8 = GhPythonScript(x=number_slider_3, y=number_slider_2)  # -> out, rectangle, dpoints, dpointe, dpointx, spheres, cube; inputs x: Int32, y: Int32
# ---------- python_8: Python ----------
__author__ = "billpower"
__version__ = "2019.12.25"

import rhinoscriptsyntax as rs

plane = rs.WorldXYPlane()   #获取xy以原点为中心的参考平面
rectangle = rs.AddRectangle(plane,40,40)

dpointsCoordinate = rs.DivideCurve(rectangle,10) #等分10矩形
dpoints = rs.AddPoints(dpointsCoordinate)   #增加等分点
print(dpoints)

format = "point_%s" #格式化字符串的模式
dpointe = []
i = 0
for i in  range(len(dpoints)):
    dpointe.append(format % str(i)) #格式化字符串并逐一追加到列表
print(dpointe)

dpointx = list(range(len(dpoints))) #建立等分点索引
print(dpointx)

#切片索引，建球
selepoints = dpoints[x:y]
spheres = []
print(selepoints)
for i in range(len(selepoints)):  #循环来处理多组数据
    sphere = rs.AddSphere(selepoints[i],3)  #提取[y](圆心，半径)
    cube = rs.AddBox(rs.BoundingBox(sphere))    #（物体，plane）
    spheres.append(cube)
#    id = rs.GetObject(sphere)
#    if id: rs.DeleteObject()

print(spheres)
# ---------- end python_8 ----------

# ----
cat = Catenary(PointA=end.End, PointB=end.Start, Length=Slider(863, range=0..2100), Gravity=Z_2)
divide_2 = DivideCurve(Curve=move.Geometry, Count=10, Kinks=False)  # -> Points, Tangents, Parameters
divide_3 = DivideCurve(Curve=line, Count=10, Kinks=False)  # -> Points, Tangents, Parameters
divide_4 = DivideCurve(Curve=cat, Count=10, Kinks=False)  # -> Points, Tangents, Parameters
cull = CullPattern(List=divide_2.Points, CullPattern=[True, False])
cull_2 = CullPattern(List=divide_3.Points, CullPattern=[True, False])
cull_3 = CullPattern(List=divide_4.Points, CullPattern=[False, True])
merge = Merge(Data1=graft(cull), Data2=graft(cull_3))  # -> flatten(Result)
merge_2 = Merge(Data1=graft(cull_2), Data2=graft(cull_3))  # -> flatten(Result)
pline = PolyLine(Vertices=merge, Closed=False)
pline_2 = PolyLine(Vertices=merge_2, Closed=False)
crv = Curve([pline, pline_2])
crv_2 = Curve([move.Geometry, line, cat])
crv_3 = Curve([crv, crv_2])
pipe = Pipe(Curve=crv_3, Radius=3, Caps=0)
