# Grasshopper definition 1_2列表eg.gh (Grasshopper 1.0.7)

pt = Point(Point(-4.609734531, 1.669987581, 0))
panel = Panel("通过gh接入数据接口，让数据输入和几何数据输出后加工处理")
python = GhPythonScript(
    Basicpoint=pt,
    Length=Slider(55, range=0..70),
    Offsetdistance=Slider(8, range=0..10),
    ExtendValue=Slider(7, range=0..10),
    HeightA=Slider(6, range=0..10),
    HeightB=Slider(10, range=0..10),
    DivideCount=Slider(20, range=0..20))  # -> out, sl, pla, plb, pm, lpm
# ---------- python: Python ----------
__author__ = "billpower"
__version__ = "2018.09.19"

import rhinoscriptsyntax as rs

#建立网架
basicpoint = Basicpoint
length = Length
matrix = rs.XformTranslation((length,0,0))
mbpoint = rs.PointTransform(basicpoint,matrix)
basicline = rs.AddLine(basicpoint,mbpoint)      #建立基线
offsetdistance = Offsetdistance
offlineA = rs.OffsetCurve(basicline,[0,0,0],offsetdistance,[0,0,1])
offlineB = rs.OffsetCurve(basicline,[0,0,0],-offsetdistance,[0,0,1])

extendvalue = ExtendValue
extendline = rs.ExtendCurveLength(basicline,0,2,extendvalue)
startpoint = rs.CurveStartPoint(extendline)
endpoint = rs.CurveEndPoint(extendline)
midpoint = rs.CurveMidPoint(extendline)     #建立三个控制点

heightA = HeightA
heightB = HeightB
matrixstartendd = rs.XformTranslation((0,0,heightA))    #移动三点控制点位
matrixmidd = rs.XformTranslation((0,0,heightB))
mstartpoint = rs.PointTransform(startpoint,matrixstartendd)
mendpoint = rs.PointTransform(endpoint,matrixstartendd)
mmidpoint = rs.PointTransform(midpoint,matrixmidd)
cpoints = []
cpoints.extend([mstartpoint,mmidpoint,mendpoint])   #三点组成列表
centercurve = rs.AddCurve(cpoints)                  #建立曲线
rs.DeleteObject(basicline)
sl= [offlineA[0],offlineB[0],centercurve]
print(sl)

dividecount = DivideCount
lineAdividepoints = rs.DivideCurve(offlineA,dividecount)
lineBdividepoints = rs.DivideCurve(offlineB,dividecount)
centercurvedividepoints = rs.DivideCurve(centercurve,dividecount)
pa = rs.AddPoints(lineAdividepoints)
pb = rs.AddPoints(lineBdividepoints)
pc = rs.AddPoints(centercurvedividepoints)
pm = pa + pb + pc
patternA = list(range(0,len(lineAdividepoints),2))  #建立保留点的模式列表
patternB = list(range(1,len(lineAdividepoints)+1,2))    #建立插入点的模式列表
print(patternA)
print(patternB)

lineAps = []
lineBps = []
lineCps = []
for i in patternA:      #建立保留点列表
    lineAps.append(lineAdividepoints[i])
    lineBps.append(lineBdividepoints[i])
    lineCps.append(centercurvedividepoints[i])
lineCpscopy = lineCps[:]
for i in range(len(patternB)):      #插入点插入
    lineCps.insert(patternB[i],lineAps[i])
    lineCpscopy.insert(patternB[i],lineBps[i])
pla = rs.AddPolyline(lineCps)
plb = rs.AddPolyline(lineCpscopy)

lpm = lineAps + lineBps +lineCps
# ---------- end python ----------
pipe = Pipe(Curve=python.sl, Radius=0.5, Caps=0)
pipe_2 = Pipe(Curve=[python.pla, python.plb], Radius=0.2, Caps=0)
sph = Sphere(Base=python.lpm, Radius=Slider(1, range=0..10))
panel_2 = Panel(python.out)
