# Grasshopper definition 3_2树形数据.gh (Grasshopper 1.0.7)

neg = Negative(Value="10")
dom = ConstructDomain(DomainStart=neg, DomainEnd="10")
pt = Point(Point(11.05637662, 29.49486373, 0))
rectangle = Rectangle(Plane=pt, XSize=dom, YSize=dom, Radius=0)  # -> Rectangle, Length
panel = Panel("将树形数据整理，调整成需要的样子")
pop2d = Populate2D(Region=rectangle.Rectangle, Count=4, Seed=Slider(3, range=0..10))

# ---- group: 逆时针选点
alongcrv = SortAlongCurve(Points=pop2d, Curve=rectangle.Rectangle)  # -> Points, Indices

# ----
pline = PolyLine(Vertices=alongcrv.Points, Closed=True)
explode = Explode(Curve=pline, Recursive=True)  # -> reparameterize(Segments), Vertices
random = Random(Range=Domain(0, 1), Number=Slider(20, range=0..100), Seed=Slider(2, range=0..10))
sort = SortList(Keys=random)  # -> Keys, ValuesA
eval = EvaluateCurve(Curve=graft(explode.Segments), Parameter=sort.Keys)  # -> simplify(Point), Tangent, Angle
points = PointList(Points=explode.Vertices, Size=Slider(3, range=0..10))

# ---- group: 整理数据
python = GhPythonScript(TreeData=eval.Point)  # -> out, OTreeData, DataTree; inputs TreeData: tree of Point3d
# ---------- python: Python ----------
__author__ = "billpower"
__version__ = "2018.09.23"

import rhinoscriptsyntax as rs
import Rhino    #调入rhino模块
from Grasshopper import DataTree    #从gh模块中调入Dataree类
from Grasshopper.Kernel.Data import GH_Path

#提取路径
data = TreeData     #将输入的数据赋值给新定义的变量,输入随机点数据
orgdata = []    #建立一个空列表
layerTree = DataTree[Rhino.Geometry.Point3d]()  #建立空的树型数据
for i in range(data.BranchCount):
    branchpath = data.Path(i)   #提取路径值
    branchpath = branchpath[0]
    #print(branchpath)

#寻找相间隔的数据，反转
    if branchpath%2 == 0:   #直接提取树形数据的索引判断，将相间隔的数据反转
        branchlst = data.Branch(i)  #提取path下的项值
        blst = []   #将数据提取为列表，用列表方法编辑数据
        for k in range(len(branchlst)):
            blst.append(branchlst[k])
        blst.reverse()  #反转数据
        orgdata.append(blst)    #重组数据
#剩下的不变
    else:
        branchlst = data.Branch(i)
        blst = []
        for k in branchlst:
            blst.append(k)
        orgdata.append(blst)
#print(orgdata)

#循环遍历列表，建立可用树形数据
for i in range(len(orgdata)):
    path = GH_Path(i)
    v = orgdata[i]  #依次提取子列表赋值给新变量
    layerTree.AddRange(v,path)  #建立路径为path，项值为v的树型数据
print(layerTree)
OTreeData = orgdata
DataTree = layerTree    #输出可用数据
# ---------- end python ----------

# ----
path_mapper = PathMapper(python.DataTree, source="{A}(i)", target="{A\2;i}")
pline_2 = PolyLine(Vertices=path_mapper, Closed=False)
panel_2 = Panel("后续利用整理可用数据")
dam = DataDam(DataA=pline_2, BufferDelay=2500000, BufferMode=2)
trim = TrimTree(Tree=dam, Depth=1)
loft = Loft(Curves=trim, Options={Adjust=False, Closed=False, LoftEnds=0, LoftSimp=0, LoftType=0, Rebuild=10, Refit=0.01})

# ---- group: 上色
srfsplit = SurfaceSplit(
    Surface=Tree({0}: [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], {1}: [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]),
    Curves=Tree({0}: [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], {1}: [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]))  # disabled
area = Area(Geometry=srfsplit)  # -> Area, Centroid; disabled
pdecon = Deconstruct(Point=area.Centroid)  # -> XComponent, YComponent, ZComponent; disabled
bnd = Bounds(Numbers=pdecon.XComponent)  # disabled
bnd_2 = Bounds(Numbers=pdecon.YComponent)  # disabled
number_slider = Slider(0, range=0..255)  # disabled
remap = RemapNumbers(Value=pdecon.XComponent, Source=bnd, Target=Domain(0, 255))  # -> Mapped, Clipped; disabled
remap_2 = RemapNumbers(Value=pdecon.YComponent, Source=bnd_2, Target=Domain(0, 255))  # -> Mapped, Clipped; disabled
rgb = ColourRGB(Alpha=255, Red=number_slider, Green=remap.Mapped, Blue=remap_2.Mapped)  # disabled
preview = CustomPreview(Geometry=srfsplit, Material=rgb)  # disabled
