# Grasshopper definition 4_1代替字符串方法.gh (Grasshopper 1.0.7)

# 字符串长度
panel = Panel("Hello Python!")
# 替换字符串
panel_2 = Panel("Hello Python!")
# 拼接字符串
panel_3 = Panel("Hello ")
# 嵌入字符串
series = Series(Start=0, Step=1, Count=10)
# 切分字符串
series_2 = Series(Start=0, Step=1, Count=10)
# 移出首位两侧空白字符
panel_4 = Panel("                                             Hello Python!")
# 排序字符串
panel_5 = Panel("Hello Python!")
# 查找字符串
panel_6 = Panel("Hello Python!")
# 统一为大写或者小写
panel_7 = Panel("Hello Python!")
# 转换字符串为列表
panel_8 = Panel("Hello Python!")
# 提取字符串
panel_9 = Panel("Hello Python!")
python = GhPythonScript()  # -> out, lststrjoin
# ---------- python: Python ----------
__author__ = "billpower"
__version__ = "2020.01.12"

import rhinoscriptsyntax as rs

lst = list(range(0,9,2))
print(lst)

lststr = []
for i in lst:
    lststr.append(str(i))
print(lststr)
sep = "+"
lststrjoin = sep.join(lststr)
print(lststrjoin)
# ---------- end python ----------
python_2 = GhPythonScript()  # -> out, lst
# ---------- python_2: Python ----------
__author__ = "billpower"
__version__ = "2020.01.12"

import rhinoscriptsyntax as rs

lst = list("Hello Python!")
print(lst)
# ---------- end python_2 ----------
python_3 = GhPythonScript()  # -> out
# ---------- python_3: Python ----------
__author__ = "billpower"
__version__ = "2020.01.12"

import rhinoscriptsyntax as rs

z = "Hello Python!"
lowerstr = z.lower()    #使用字符串的方法返回小写字母
print(lowerstr)
upperstr = z.upper()    #使用字符串的方法返回大写字母
print(upperstr)
# ---------- end python_3 ----------
join = TextJoin(Text=series, Join="+")
join_2 = TextJoin(Text=series_2, Join="+")
split = TextSplit(Text=join_2, Separators="+")
python_4 = GhPythonScript()  # -> out
# ---------- python_4: Python ----------
__author__ = "billpower"
__version__ = "2020.01.12"

import rhinoscriptsyntax as rs

z = "Hello Python!"
substr = z[6:]  #使用列表分片的方法，提取部分字符串
print(substr)
# ---------- end python_4 ----------
python_5 = GhPythonScript()  # -> out, length
# ---------- python_5: Python ----------
__author__ = "billpower"
__version__ = "2020.01.12"

import rhinoscriptsyntax as rs

stri = "Hello Python!"
length = len(stri)  #使用函数len()计算长度
print(length)
# ---------- end python_5 ----------
len = TextLength(Text=panel)
concat = Concatenate(FragmentA=panel_3, FragmentB="Python!")
python_6 = GhPythonScript()  # -> out, z
# ---------- python_6: Python ----------
__author__ = "billpower"
__version__ = "2020.01.12"

import rhinoscriptsyntax as rs

x = "Hello "
y = "Python!"
z = x+y
print(z)
# ---------- end python_6 ----------
tdist = TextDistance(TextA=panel_6, TextB="Python!", Case=True)
python_7 = GhPythonScript()  # -> out
# ---------- python_7: Python ----------
__author__ = "billpower"
__version__ = "2020.01.12"

import rhinoscriptsyntax as rs

stri = "Hello Python!"
d = "Python!"
ds = stri.find(d)
print(ds)
# ---------- end python_7 ----------
trim = TextTrim(Text=panel_4, Start=True, End=True)
chars = Characters(Text=panel_5)  # -> Result, Unicode
python_8 = GhPythonScript()  # -> out
# ---------- python_8: Python ----------
__author__ = "billpower"
__version__ = "2020.01.12"

import rhinoscriptsyntax as rs

strs = "       Hello Python!"
strs = strs.strip()  #使用列表分片的方法，提取部分字符串
print(strs)
# ---------- end python_8 ----------
rep = ReplaceText(Text=panel_2, Find="Python", Replace="Grasshopper", RecursiveReplace=False)
python_9 = GhPythonScript()  # -> out
# ---------- python_9: Python ----------
__author__ = "billpower"
__version__ = "2020.01.12"

import rhinoscriptsyntax as rs

stri = "Hello Python!"
strlst = list(stri)     #将字符串转变为列表
strlst.sort()       #排序，但是先拍大写
print(strlst)

strilower = stri.lower()
strlstlower = list(strilower)
strlstlower.sort()  #再次排序
print(strlstlower)
# ---------- end python_9 ----------
python_10 = GhPythonScript()  # -> out
# ---------- python_10: Python ----------
__author__ = "billpower"
__version__ = "2020.01.12"

import rhinoscriptsyntax as rs

strr = "Hello Python!"
strrr = strr.replace("Python","Grasshopper")
print(strrr)
# ---------- end python_10 ----------
panel_10 = Panel(python.lststrjoin)
panel_11 = Panel(python_2.lst)
panel_12 = Panel(split)
panel_13 = Panel(python_3)
panel_14 = Panel(join)
panel_15 = Panel(python_4)
case = TextCase(Text=panel_7, Culture=127)  # -> UpperCase, LowerCase
panel_16 = Panel(concat)
panel_17 = Panel(python_6.z)
panel_18 = Panel(chars.Result)
panel_19 = Panel(trim)
panel_20 = Panel(python_8)
fragment = TextFragment(Text=panel_9, Start=Slider(4, range=0..10))
panel_21 = Panel(len)
panel_22 = Panel(python_5.length)
chars_2 = Characters(Text=panel_8)  # -> Result, Unicode
panel_23 = Panel(tdist)
panel_24 = Panel(python_7)
panel_25 = Panel(python_10)
panel_26 = Panel(python_9)
panel_27 = Panel(rep)
panel_28 = Panel(join_2)
tsort = SortText(Keys=chars.Result, Culture=127)  # -> Keys, Values
python_11 = GhPythonScript()  # -> out, length
# ---------- python_11: Python ----------
__author__ = "billpower"
__version__ = "2020.01.12"

import rhinoscriptsyntax as rs

lst = list(range(0,9,2))
print(lst)

lststr = []
for i in lst:
    lststr.append(str(i))
print(lststr)
sep = "+"
lststrjoin = sep.join(lststr)   #加入字符串
print(lststrjoin)

lstsplit = lststrjoin.split("+")    #join的逆方法，输入分隔符
print(lstsplit)
# ---------- end python_11 ----------
panel_29 = Panel(fragment)
panel_30 = Panel(case.UpperCase)
panel_31 = Panel(case.LowerCase)
panel_32 = Panel(chars_2.Result)
panel_33 = Panel(tsort.Keys)
panel_34 = Panel(python_11.out)
