# Grasshopper definition 3_2清式五檩举架小式.gh (Grasshopper 1.0.7)

步架值 = Slider(4.78, range=0..10)
举架高 = Slider(0.4, range=0..1)
举架差值 = Slider(0.2, range=0..1)
檩条半径 = Slider(0.329, range=0..1)
步架数 = Slider(3, range=0..10)

# ---- group: 檩条举架高度
python = GhPythonScript(X=步架值, Start=举架高, Step=举架差值, PS=檩条半径, Count=步架数)  # -> out, M
# ---------- python: Python ----------
__author__ = "billpower"
__version__ = "2020.01.19"

import rhinoscriptsyntax as rs

#start举架高,step举架差值,count步架数,h步架值,ps檩条半径
start,step,count,h,ps = float(Start),float(Step),int(Count),float(X),float(PS)

#步架值列表
lst = []    #用于放置步架值
lst.insert(0,0)
lst.append(start)

for i in range(count-1):
    start += step
    lst.append(start)
print(lst)

#举高列表
ml = []
for n in lst:
    nm = n*h
    ml.append(nm)
mll = ml.pop()  #移除举高列表最后一个值
mllm = mll+(2*ps-0.032)
ml.append(mllm)
mlo = mllm/h   #计算包含平水高的举高的举架值
print(mllm)

Mu = []
M = []
for q in range(len(ml)):
    Mu.append(ml[q])
    M.append(sum(Mu))
print(M)
# ---------- end python ----------

# ---- group: 几何数据处理
repeat = RepeatData(Data=步架值, Length=步架数)  # -> flatten(Data)
ins = InsertItems(List=repeat, Item=0, Indices=0, Wrap=True)  # -> flatten(List)
shift = ShiftList(List=reverse(python.M), Shift=1, Wrap=False)
merge = Merge(Data1=ins, Data2=reverse(repeat))
merge_2 = Merge(Data1=python.M, Data2=shift)  # -> flatten(Result)
ma = MassAddition(Input=merge)  # -> Result, PartialResults
pt = ConstructPoint(XCoordinate=ma.PartialResults, YCoordinate=0, ZCoordinate=merge_2)

# ----
number_slider = Slider(10, range=0..10)
Y = UnitY(Factor=1)
circle = CircleCNR(Center=pt, Normal=Y, Radius=檩条半径)
Y_2 = UnitY(Factor=number_slider)
line = LineSDL(Start=pt, Direction=Y_2, Length=number_slider)
extr = Extrude(Base=circle, Direction=Y_2)
loft = Loft(Curves=line, Options={Adjust=False, Closed=False, LoftEnds=0, LoftSimp=0, LoftType=3, Rebuild=10, Refit=0.01})
