# Grasshopper definition 4_1构建展平.gh (Grasshopper 1.0.7)
# plug-ins: MeshEdit Components

# ---- group: 构建原始网架
number_slider = Slider(8, range=0..10)
pt = Point(Point(463.7536501, -47.26728658, 0))
msphere = MeshSphere(Base=pt, Radius=Slider(74.48, range=0..100), UCount=number_slider, VCount=number_slider)
medges = MeshEdges(Mesh=msphere)  # -> NakedEdges, InteriorEdges, NonManifoldEdges
explode = MeshExplode(Mesh=msphere, Interpolate=False)
mesh = Mesh(explode)

# ----
geo = Geometry(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)
srf = Surface(geo)
area = Area(Geometry=srf)  # -> Area, Centroid
evalsrf = EvaluateSurface(Surface=srf, Point=area.Centroid)  # -> Point, Normal, UDirection, VDirection, Frame

# ---- group: 数列
python = GhPythonScript(Start=Slider(16, range=0..100), End=Slider(24, range=0..100), Step=Slider(1, range=0..10))  # -> out, series
# ---------- python: Python ----------
__author__ = "billpower"
__version__ = "2020.01.26"

import rhinoscriptsyntax as rs
import math
start = int(Start)
end = int(End)
step = int(Step)
series = []

series.append(start)    #将初始值加入列表
#for i in range(int(math.floor((end-start)/step))):
while True:
    start += step
    if start>=end:break
    series.append(start)

print(series)
# ---------- end python ----------

# ----
vec = Vector(evalsrf.Frame)
orient = OrientDirection(Geometry=srf, PointA=area.Centroid, DirectionA=vec, PointB=Point(0, 0, 0), DirectionB=Vector(0, 0, 1))  # -> Geometry, Transform

# ---- group: 提取需要展品面
item = ListItem(List=mesh, Index=python.series, Wrap=True)

# ----
panel = Panel(vec)

# ---- group: 三点确定一面
pt_2 = Point([Point(654.8515769, -211.5402886, 0), Point(607.1579071, -318.3998416, 0), Point(713.3599842, -259.3981966, 0)])

# ---- group: 展平程序
python_2 = GhPythonScript(meshes=item, Locationpoint=pt_2)  # -> out, xymeshes; inputs meshes: list, Locationpoint: list
# ---------- python_2: Python ----------
__author__ = "billpower"
__version__ = "2020.01.26"

import rhinoscriptsyntax as rs
#分解mesh，获取点坐标列表
lp = []
#print(Locationpoint)
for i in Locationpoint: #循环遍历点，获取点坐标列表
    lp.append(rs.PointCoordinates(i))
#print(lp)

#
xymeshes = []
for i in range(len(meshes)):
    if i == 0:
        mesh0point = rs.MeshVertices(meshes[i]) #获取第一个单元面的所有顶点
        xymesh0 = rs.OrientObject(meshes[i],mesh0point,lp,1)    
        #将第一个单元面放置在二维平面上，初始参考点为第一个单元面的顶点，目标参考点为输入的点对象（至少三个点，并转化为点坐标列表
        xymeshes.append(xymesh0)    #将第一个展平面加入列表
        #print(xymeshes)
    else:
        vertices2 = rs.MeshVertices(meshes[i])  #获取索引值为i时，单元面所有顶点
        vertices1 = rs.MeshVertices(meshes[i-1])    #i-1时，单元面的所有顶点
        ver = [m for m in vertices1 for n in vertices2 if m==n] #遍历两mesh中的点，提取重合点ab
        #print(vertices2)
        a = ver[0]
        b = ver[1]
        indexa = vertices1.index(a) #提取ab点在i-1单元中的索引值
        indexb = vertices1.index(b)
        d = [m for m in vertices2 if m not in ver][0]
        #使用列表推导式循环遍历索引值为i时单元面的顶点，并且要求提取的条件为不重合的点，如果为四边，因此增加[0]
        refvertice = rs.MeshVertices(xymeshes[i-1]) #获取已经转化为二维单元面i-1的单元顶点
        indexc = [c for c in range(0,3) if c != indexa and c!=indexb]   #获取i-1单元顶点中ab以外c的索引值
        refverticespoint = rs.MirrorObject(rs.AddPoint(refvertice[indexc[0]]),refvertice[indexa],refvertice[indexb])#c'参考a'b',获取cm'点
        mirrorpoint = rs.PointCoordinates(refverticespoint) #获取cm'点坐标
        xymesh = rs.OrientObject(meshes[i],[a,b,d],[refvertice[indexa],refvertice[indexb],mirrorpoint],1)
        #将i单元面转化为二维面，初始参考点为待转化abd，目标为a',b',cm'
        xymeshes.append(xymesh)
    vertices2=[]
    vertices1=[]
    ver = []
print(xymeshes)
# ---------- end python_2 ----------

# ----
number_slider_2 = Slider(7, range=0..10)
medges_2 = MeshEdges(Mesh=python_2.xymeshes)  # -> NakedEdges, InteriorEdges, NonManifoldEdges
facen = FaceNormals(Mesh=item)  # -> flatten(Centers), Normals
facen_2 = FaceNormals(Mesh=python_2.xymeshes)  # -> flatten(Centers), Normals
tag = TextTag3D(Location=facen.Centers, Text=python.series, Size=number_slider_2, Justification=7)
tag_2 = TextTag3D(Location=facen_2.Centers, Text=python.series, Size=number_slider_2, Justification=7)
