# Grasshopper definition 4_4最短路径.gh (Grasshopper 1.0.7)
# plug-ins: Pufferfish, Shortest Walk in Gh

pipeline = GeometryPipeline(
    GroupByLayer=False,
    GroupByType=False,
    IncludeHidden=True,
    IncludeLocked=True,
    LayerFilter="rode",
    NameFilter="*",
    SublayerFiltering=True,
    TypeFilter=4)
切分好的曲线列表 = Curve([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])
起点到终点的直线 = Line(Line((1677.872759, 1129.123039, 0), (-274.0765269, -2030.388093, 0)))
crv = Curve([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])

# ---- group: 起点和终点
pt = Point([Point(9543.535087, 1065.329879, 0), Point(4744.329373, -2794.456844, 0)])
item = ListItem(List=pt, Index=0, Wrap=True)
item_2 = ListItem(List=pt, Index=-1, Wrap=True)
ln = Line(StartPoint=item, EndPoint=item_2)

# ---- group: 直线打断
python = GhPythonScript(Lines=crv)  # -> out, IntersectionPoints, PLS; inputs Lines: list
# ---------- python: Python ----------
__author__ = "billpower"
__version__ = "2020.01.28"

import rhinoscriptsyntax as rs
li = Lines
lst = []    #直线首尾点和交点
pls = []    #根据交点构建的直线
plsp = []   #用于临时放置循环每一步的交点
pl = []     #用于临时放置循环每一步的交点和首尾点

#嵌套循环得出所有直线交点
for i in range(len(li)):
    for p in li:
        point = rs.LineLineIntersection(li[i],p)
        if point and rs.IsPointOnCurve(li[i],point[0]) and rs.IsPointOnCurve(p,point[0]):
        #有交点且同时在两直线上
            lst.append(point[0])
            plsp.append(point[0])
    #取首尾点
    sta = rs.CurveStartPoint(li[i])
    end = rs.CurveEndPoint(li[i])
    #加入临时点列表
    pl = [sta]+plsp+[end]   #单个数据加[]改为列表
    #排序点并且连为折线
    pls.append(rs.AddPolyline(rs.SortPointList(pl)))
    plsp = []
    pl = []

print(lst)
print(PLS)
IntersectionPoints = lst
PLS = pls
# ---------- end python ----------

# ---- group: 最短路径插件
shortwalk = ShortestWalk(Curves=切分好的曲线列表, WantedPath=起点到终点的直线)  # -> ShortestWalk, Succession, Direction, Length

# ----
explode = Explode(Curve=python.PLS, Recursive=True)  # -> flatten(Segments), Vertices
crv_2 = Curve(shortwalk.ShortestWalk)

# ---- group: 最短路径插件
shortwalk_2 = ShortestWalk(Curves=explode.Segments, WantedPath=ln)  # -> ShortestWalk, Succession, Direction, Length

# ----
offcrv = OffsetCurve(Curve=crv_2, Distance=10, Plane=PlaneXY(0, 0, 0), BothSides=True, Kinks=0, CapType=1)
offcrv_2 = OffsetCurve(Curve=shortwalk_2.ShortestWalk, Distance=10, Plane=PlaneXY(0, 0, 0), BothSides=True, Kinks=0, CapType=1)
boundary = BoundarySurfaces(Edges=offcrv)
boundary_2 = BoundarySurfaces(Edges=offcrv_2)
preview = CustomPreview(Geometry=boundary_2, Material=ColourSwatch(SwatchColor=RGB(255, 255, 255)))
