# Grasshopper definition 3_1树形数据和字典.gh (Grasshopper 1.0.7)

panel = Panel("DataTree结构")
panel_2 = Panel("DataTree方法")
pt = Point(Point(-10.21179238, 13.19054344, 0))
number_slider = Slider(6, range=0..10)
# 用python对gh的树形数据提取，重组，检查，复制
number_slider_2 = Slider(6, range=0..10)
pt_2 = Point(Point(-111.5165969, 15.30211769, 0))
xy = XYPlane(Origin=pt)
xy_2 = XYPlane(Origin=pt_2)
sqgrid = Square(Plane=xy, Size=Slider(11, range=0..100), ExtentX=number_slider, ExtentY=number_slider)  # -> Cells, Points
sqgrid_2 = Square(Plane=xy_2, Size=Slider(11, range=0..100), ExtentX=number_slider_2, ExtentY=number_slider_2)  # -> Cells, Points
area = Area(Geometry=sqgrid.Cells)  # -> Area, Centroid
area_2 = Area(Geometry=sqgrid_2.Cells)  # -> Area, Centroid
树形数据方法 = GhPythonScript(TreeData=area_2.Centroid)  # -> out, OTreeData, DB, DC, addpoint, alldata, branchM, branchMP, DM, DF; inputs TreeData: tree of GeometryBase
# ---------- 树形数据方法: Python ----------
__author__ = "billpower"
__version__ = "2020.01.05"

#用python对gh的树形数据提取，重组，检查，复制

import rhinoscriptsyntax as rs
import Rhino
from Grasshopper import DataTree
from Grasshopper.Kernel.Data import GH_Path

data = TreeData
print(data)     #检查每个路径下的项值

DA = DataTree[Rhino.Geometry.GeometryBase]()    #定义空的树形数据
print(DA)

Glst = []   #建立空的列表，用于分别放置各个路径下的所有项值，每个路径下的项值被放置于一个列表中
for i in range(data.BranchCount):   #BranchCount路径数，通过循环树形数据下每一个路径下的所有项值
    branchlst = data.Branch(i)  #Branch（）路径下的项，逐一提取树形数据下每一个路径下的所有项值
    lst = []    #建立空列表，提取路径下的各个项值
    for k in range(len(branchlst)):     #在各路径下所有项值循环
        lst.append(branchlst[k])    #把项值加入列表
    Glst.append(lst)     #再总结数据
print(Glst)

branchname = 1
DBPath = GH_Path(branchname)    #将1转换为{1}
DB = DataTree[Rhino.Geometry.GeometryBase](Glst[0],DBPath) #（路径，{1}）提取树形数据
print(DB)

DC = DataTree[Rhino.Geometry.GeometryBase](DB)  #复制
print(DC)

OTreeData = Glst

#############################################################################
#接上文程序print(DC)后
#提取列表中列表的项值
addpoint = Glst[0][1]   #提取Glst列表索引值为0的子列表，继而提取列表索引值为1的项值
print(addpoint)     #检查
#追加项值，默认最后
DC.Add(addpoint)    #使用方法在最后一个路径上追加项（点）
print(DC)   #检查

DC.Add(addpoint,GH_Path(59))    #追加数据，建立新的路径
print(DC)

addpoints = Glst[3]     #提取Glst列表索引值为3的子列表
DC.AddRange(addpoints,GH_Path(9))   #使用此方法追加一个指定路径的列表
print(DC)


#提取与清除树形数据的方法
alldata = DC.AllData()  #将所有树形数据拍平，返回到一个列表下
print(alldata)

branchM = DC.Branch(2)  #提取索引值为2的路径分支
print(branchM)

branchMP = DC.Branch(GH_Path(59))   #指定路径的路径分支
print(branchMP)

DM = DataTree[Rhino.Geometry.GeometryBase](DC)  #复制树形数据
DM.Clear()    #此方法清除数据和结构
print(DM)

DM = DataTree[Rhino.Geometry.GeometryBase](DC)  #复制树形数据
DM.ClearData()    #清除数据保留结构
print(DM)

#增加路径分支、数据拍平和移植项值的方法
DC.EnsurePath(GH_Path(60))  #增加新的路径
print(DC)

DF = DataTree[Rhino.Geometry.GeometryBase](DC)  #复制
DF.Flatten()    #拍平
print(DF)

DF.Graft()  #上升，移植所有路径分支下的项值到各自单独的路径分支下
print(DF)

DF = DataTree[Rhino.Geometry.GeometryBase](DC)  #复制
DF.Graft(GH_Path(9))    #上升{9}下的数据
print(DF)
# ---------- end 树形数据方法 ----------
树形数据结构 = GhPythonScript(TreeData=area_2.Centroid)  # -> out, OTreeData, DB, DC; inputs TreeData: tree of GeometryBase
# ---------- 树形数据结构: Python ----------
__author__ = "billpower"
__version__ = "2020.01.05"

#用python对gh的树形数据提取，重组，检查，复制

import rhinoscriptsyntax as rs
import Rhino
from Grasshopper import DataTree
from Grasshopper.Kernel.Data import GH_Path

data = TreeData
print(data)     #检查每个路径下的项值

DA = DataTree[Rhino.Geometry.GeometryBase]()    #定义空的树形数据
print(DA)

Glst = []   #建立空的列表，用于分别放置各个路径下的所有项值，每个路径下的项值被放置于一个列表中
for i in range(data.BranchCount):   #BranchCount路径数，通过循环树形数据下每一个路径下的所有项值
    branchlst = data.Branch(i)  #Branch（）路径下的项，逐一提取树形数据下每一个路径下的所有项值
    lst = []    #建立空列表，提取路径下的各个项值
    for k in range(len(branchlst)):     #在各路径下所有项值循环
        lst.append(branchlst[k])    #把项值加入列表
    Glst.append(lst)     #再总结数据
print(Glst)

branchname = 1
DBPath = GH_Path(branchname)    #将1转换为{1}
DB = DataTree[Rhino.Geometry.GeometryBase](Glst[0],DBPath) #（路径，{1}）提取树形数据
print(DB)

DC = DataTree[Rhino.Geometry.GeometryBase](DB)  #复制
print(DC)

OTreeData = Glst
# ---------- end 树形数据结构 ----------
path = DataPath(Slider(2, range=0..10))
number_slider_3 = Slider(5, range=0..10)
flip = FlipMatrix(Data=area.Centroid)  # -> simplify(Data)
branch = TreeBranch(Tree=flip, Path=path, MaintainPaths=True)
panel_3 = Panel(area_2.Centroid)
pt_3 = Point(树形数据结构.DB)
viewer = ParamViewer(flip)
points = PointList(Points=flip, Size=Slider(4, range=0..10))
rectangle = Rectangle(Plane=branch, XSize=number_slider_3, YSize=number_slider_3, Radius=0)  # -> Rectangle, Length
panel_4 = Panel(pt_3)
