# Grasshopper definition 3_2树形数据.gh (Grasshopper 1.0.7)

neg = Negative(Value="10")
dom = ConstructDomain(DomainStart=neg, DomainEnd="10")
pt = Point(Point(11.05637662, 29.49486373, 0))
rectangle = Rectangle(Plane=pt, XSize=dom, YSize=dom, Radius=0)  # -> Rectangle, Length
pop2d = Populate2D(Region=rectangle.Rectangle, Count=4, Seed=Slider(3, range=0..10))
alongcrv = SortAlongCurve(Points=pop2d, Curve=rectangle.Rectangle)  # -> Points, Indices
pline = PolyLine(Vertices=alongcrv.Points, Closed=True)
explode = Explode(Curve=pline, Recursive=True)  # -> reparameterize(Segments), Vertices
random = Random(Range=Domain(0, 1), Number=Slider(100, range=0..100), Seed=Slider(3, range=0..10))
sort = SortList(Keys=random)  # -> Keys, ValuesA
eval = EvaluateCurve(Curve=graft(explode.Segments), Parameter=sort.Keys)  # -> simplify(Point), Tangent, Angle
python = GhPythonScript(TreeData=eval.Point)  # -> out, OTreeData, DataTree; inputs TreeData: tree of Point3d
# ---------- python: Python ----------
__author__ = "billpower"
__version__ = "2018.09.23"

import rhinoscriptsyntax as rs
import Rhino    #调入rhino模块
from Grasshopper import DataTree    #从gh模块中调入Dataree类
from Grasshopper.Kernel.Data import GH_Path
data = TreeData     #将输入的数据赋值给新定义的变量,输入随机点数据
orgdata = []    #建立一个空列表
layerTree = DataTree[Rhino.Geometry.Point3d]()  #建立空的树型数据
for i in range(data.BranchCount):
    branchpath = data.Path(i)
    branchpath = branchpath[0]
    #print(branchpath)

    if branchpath%2 == 0:   #直接提取树形数据的索引判断
        branchlst = data.Branch(i)
        blst = []   #将数据提取为列表，用列表方法编辑数据
        for k in range(len(branchlst)):
            blst.append(branchlst[k])
        blst.reverse()
        orgdata.append(blst)    #重构数据
    else:
        branchlst = data.Branch(i)
        blst = []
        for k in branchlst:
            blst.append(k)
        orgdata.append(blst)
#print(orgdata)
        
for i in range(len(orgdata)):
    path = GH_Path(i)
    v = orgdata[i]
    layerTree.AddRange(v,path)  #建立路径为path，值为v的树型数据
print(layerTree)
OTreeData = orgdata
DataTree = layerTree
# ---------- end python ----------
path_mapper = PathMapper(python.DataTree, source="{A}(i)", target="{A\2;i}")
pline_2 = PolyLine(Vertices=path_mapper, Closed=False)
