# Grasshopper definition 3树形数据和字典.gh (Grasshopper 1.0.7)

number_slider = Slider(6, range=0..10)
pt = Point(Point(-111.5165969, 15.30211769, 0))
pt_2 = Point(Point(-10.21179238, 13.19054344, 0))
number_slider_2 = Slider(6, range=0..10)
xy = XYPlane(Origin=pt)
xy_2 = XYPlane(Origin=pt_2)
sqgrid = Square(Plane=xy, Size=Slider(11, range=0..100), ExtentX=number_slider, ExtentY=number_slider)  # -> Cells, Points
sqgrid_2 = Square(Plane=xy_2, Size=Slider(11, range=0..100), ExtentX=number_slider_2, ExtentY=number_slider_2)  # -> Cells, Points
area = Area(Geometry=sqgrid.Cells)  # -> Area, Centroid
python = GhPythonScript(TreeData=area.Centroid)  # -> out, OTreeData, DB, DC; inputs TreeData: tree of GeometryBase
# ---------- python: Python ----------
__author__ = "billpower"
__version__ = "2020.01.05"

import rhinoscriptsyntax as rs
import Rhino
from Grasshopper import DataTree
from Grasshopper.Kernel.Data import GH_Path

data = TreeData
print(data)     #检查每个路径下的项值

DA = DataTree[Rhino.Geometry.GeometryBase]()    #定义空的树形数据
print(DA)

Glst = []   #建立空的列表，用于分别放置各个路径下的所有项值，每个路径下的项值被放置于一个列表中
for i in range(data.BranchCount):   #BranchCount路径数，通过循环树形数据下每一个路径下的所有项值
    branchlst = data.Branch(i)  #Branch（）路径下的项，逐一提取树形数据下每一个路径下的所有项值
    lst = []    #建立空列表，提取路径下的各个项值
    for k in range(len(branchlst)):     #在各路径下所有项值循环
        lst.append(branchlst[k])    #把项值加入列表
    Glst.append(lst)     #再总结数据
print(Glst)

branchname = 1
DBPath = GH_Path(branchname)    #将1转换为{1}
DB = DataTree[Rhino.Geometry.GeometryBase](Glst[0],DBPath) #（路径，{1}）提取树形数据
print(DB)

DC = DataTree[Rhino.Geometry.GeometryBase](DB)
print(DC)

OTreeData = Glst
# ---------- end python ----------
area_2 = Area(Geometry=sqgrid_2.Cells)  # -> Area, Centroid
path = DataPath(Slider(2, range=0..10))
number_slider_3 = Slider(5, range=0..10)
flip = FlipMatrix(Data=area_2.Centroid)  # -> simplify(Data)
branch = TreeBranch(Tree=flip, Path=path, MaintainPaths=True)
panel = Panel(area.Centroid)
pt_3 = Point(python.DB)
viewer = ParamViewer(flip)
panel_2 = Panel(pt_3)
points = PointList(Points=flip, Size=Slider(4, range=0..10))
rectangle = Rectangle(Plane=branch, XSize=number_slider_3, YSize=number_slider_3, Radius=0)  # -> Rectangle, Length
