# Grasshopper definition 1_1折角建筑.gh (Grasshopper 1.0.7)

pt = Point(Point(62.16792867, -3.939306252, 0))
python = GhPythonScript(
    basicpoint=pt,
    lengthunit=Slider(52, range=0..100),
    angle=Slider(0.86, range=0..1),
    offsetvalue=Slider(57, range=0..100),
    topbplineheight=Slider(35, range=0..100),
    multiple1=Slider(3, range=0..10),
    multiple2=Slider(4, range=0..10),
    multiple3=Slider(5, range=0..10))  # -> out, bpoints, bpline0, bplines, offsetbplines, topbplinecenter, topbpline; inputs basicpoint: Point3d
# ---------- python: Python ----------
__author__ = "billpower"
__version__ = "2020.01.30"

import rhinoscriptsyntax as rs
import math
import random

bpoint0 = (basicpoint[0],basicpoint[1],basicpoint[2])
#初始定位点
bpoints = [] #
bpoints.append(bpoint0)
bpoint1 = (bpoint0[0]+multiple1*lengthunit,bpoint0[1],bpoint0[2])
#根据初始定位点坐标计算第一个折线点的坐标
bpoints.append(bpoint1)

hypotenuse = multiple2*lengthunit   #计算第二段折线长度基础值
bpoint2 = (bpoint1[0]+hypotenuse*math.sin(angle),bpoint1[1]+hypotenuse*math.cos(angle),bpoint1[2])
#第二个折线点的坐标
bpoints.append(bpoint2)
bpoint3 = (bpoint2[0]+multiple3*lengthunit,bpoint2[1],bpoint2[2])
#
bpoints.append(bpoint3)
bpline0 = rs.AddPolyline(bpoints)

bplines = []
bplines.append(bpline0)
for i in range(1,4):
    dividecurvelength = rs.CopyObject(bpline0,[0,0,20*i])
    bplines.append(dividecurvelength)
    
offsetbplines = []
for j in bplines:
    offsetbpline=rs.OffsetCurve(j,[0,0,0],offsetvalue)
    offsetbplines.append(offsetbpline)

topbplinecenter = rs.OffsetCurve(bplines[-1],[0,0,0],offsetvalue/2) #用于屋脊水平方向折线的基础线
topbpline = rs.CopyObject(topbplinecenter,[0,0,topbplineheight])    #根据新的坐标点复制屋脊水平方向折线的基础线
#rs.DeleteObject(topbplinecenter)
# ---------- end python ----------
pt_2 = ConstructPoint(XCoordinate=0, YCoordinate=0, ZCoordinate=0)
