# Grasshopper definition 4_1代替字符串方法.gh (Grasshopper 1.0.7)

# 拼接字符串
panel = Panel("Hello ")
# 嵌入字符串
series = Series(Start=0, Step=1, Count=10)
# 转换字符串为列表
panel_2 = Panel("Hello Python!")
python = GhPythonScript()  # -> out, lststrjoin
# ---------- python: Python ----------
__author__ = "billpower"
__version__ = "2020.01.12"

import rhinoscriptsyntax as rs

lst = list(range(0,9,2))
print(lst)

lststr = []
for i in lst:
    lststr.append(str(i))
print(lststr)
sep = "+"
lststrjoin = sep.join(lststr)
print(lststrjoin)
# ---------- end python ----------
python_2 = GhPythonScript()  # -> out, lst
# ---------- python_2: Python ----------
__author__ = "billpower"
__version__ = "2020.01.12"

import rhinoscriptsyntax as rs

lst = list("Hello Python!")
print(lst)
# ---------- end python_2 ----------
join = TextJoin(Text=series, Join="+")
concat = Concatenate(FragmentA=panel, FragmentB="Python!")
python_3 = GhPythonScript()  # -> out, z
# ---------- python_3: Python ----------
__author__ = "billpower"
__version__ = "2020.01.12"

import rhinoscriptsyntax as rs

x = "Hello "
y = "Python!"
z = x+y
print(z)
# ---------- end python_3 ----------
panel_3 = Panel(python.lststrjoin)
panel_4 = Panel(python_2.lst)
panel_5 = Panel(join)
panel_6 = Panel(concat)
panel_7 = Panel(python_3.z)
chars = Characters(Text=panel_2)  # -> Result, Unicode
panel_8 = Panel(chars.Result)
