# Grasshopper definition 20180208蝴蝶动画.gh (Grasshopper 0.9.76)
# plug-ins: Python Interpreter

toggle = BooleanToggle(True)
timer = Timer(TimerInterval=10, Target=c_script)  # disabled
c_script = CSharpScript(y=Button())  # -> out, A; inputs y: Boolean
# ---------- c_script: C# ----------
    Print("N={0}", N);
    N = N + 2;
    A = N;
    if(y)
      N = 0;
# ---------- c_script: C# additional code ----------
  int N = 0;
# ---------- end c_script ----------
number_slider = Slider(3000, range=0..3000)
python = PythonScript(num=c_script.A)  # -> out, a; inputs num: Int32
# ---------- python: Python ----------
import rhinoscriptsyntax as rs
import math

a = []
for t in rs.frange(0,24*math.pi,(24*math.pi)/num):
    y = (math.cos(t))*(math.e**(math.cos(t))-2*math.cos(4*t)-math.sin(t/12)**5)
    x = (math.sin(t))*(math.e**(math.cos(t))-2*math.cos(4*t)-math.sin(t/12)**5)
    y = y*100
    x = x*100
    a.append(rs.AddPoint(x,y,0))
# ---------- end python ----------
lng = ListLength(List=python.a)
number_slider_2 = Slider(63, range=0..100)
number_slider_3 = Slider(1000, range=0..1000)
gradient = Gradient(
    LowerLimit=lng,
    UpperLimit=1,
    Parameter=python.a,
    stops=[0: RGB(234, 38, 0), 0.231: RGB(75, 107, 169), 0.47: RGB(234, 126, 0), 0.715: RGB(173, 203, 249), 0.917: RGB(254, 244, 84)])
pline = PolyLine(Vertices=python.a, Closed=False)
preview = CustomPreview(Geometry=pline, Shader=ColourSwatch(SwatchColor=RGB(230, 230, 230)))
preview_2 = CustomPreview(Geometry=python.a, Shader=gradient)
panel = Panel(python.a)
