# Grasshopper definition 20180210截图.gh (Grasshopper 0.9.76)
# plug-ins: Python Interpreter

toggle = BooleanToggle(True)
python = PythonScript()  # -> out, a
# ---------- python: Python ----------
import System as s
import Rhino as r
import time

now = time.strftime('%Y-%m-%d',time.localtime(time.time()))
num = str(now)
print(now)
# ---------- end python ----------
python_2 = PythonScript(x=Button())  # -> out, a
# ---------- python_2: Python ----------
import System as s
import Rhino as r
import time

size = s.Drawing.Size(1920,1080)
via = r.RhinoDoc.ActiveDoc.Views.ActiveView
bm = via.CaptureToBitmap(size)

now = time.strftime('%Y%m%d-%H.%M.%S',time.localtime(time.time()))
num = str(now)

print(num)
path = "D:\\users\\po\\" + num + ".png"
if x == True:
    bm.Save(path)
# ---------- end python_2 ----------
